# Grasshopper definition differentialGrowth.gh (Grasshopper 1.0.7)
# plug-ins: Anemone, Kangaroo2 Components

boolean_toggle = BooleanToggle(True)  # disabled
curve = Curve(<curve referenced from the Rhino model>)  # disabled
button = Button()  # disabled
number_slider = Slider(2.547, range=0..10)  # disabled
panel = Panel("400")  # disabled
surface = Surface(<surface referenced from the Rhino model>)
curve_2 = Curve(<curve referenced from the Rhino model>)
point = Point()  # disabled

# ---- group: Attr Point
number_slider_2 = Slider(0.7, range=0..1)  # disabled
general_seperation = Number(number_slider)  # disabled
point_2 = Point(Point(7.655105111, 0.7632067726, -1.832604245))  # disabled
distance = Distance(PointA=point, PointB=point_2)  # disabled
construct_domain = ConstructDomain(DomainStart=number_slider_2, DomainEnd=general_seperation)  # disabled
bounds = Bounds(Numbers=distance)  # disabled
remap_numbers = RemapNumbers(Value=distance, Source=bounds, Target=construct_domain)  # -> Mapped, Clipped; disabled
graft_tree = GraftTree(Tree=remap_numbers.Mapped, IncludeEmptyLists=True, IncludeNullItems=True)  # disabled
simplify_tree = SimplifyTree(Tree=graft_tree, Front=False)  # disabled

# ----
divide_length = DivideLength(Curve=curve, Length=number_slider_2)  # -> Points, Tangents, Parameters; disabled
loop_start = LoopStart(Repeat=panel, Trigger=button, Data=divide_length.Points)  # -> port, Counter, Data; disabled

# ---- group: Flockmates
point_3 = Point(point)  # disabled
panel_2 = Panel("5")  # disabled
closest_points = ClosestPoints(Point=point_3, Cloud=point_3, Count=panel_2)  # -> ClosestPoint, CPIndex, Distance; disabled
graft_tree_2 = GraftTree(Tree=point_3, IncludeEmptyLists=True, IncludeNullItems=True)  # disabled
smaller_than = SmallerThan(FirstNumber=closest_points.Distance, SecondNumber=simplify_tree)  # -> SmallerThan, OrEqualTo; disabled
vector_2pt = Vector2Pt(PointA=closest_points.ClosestPoint, PointB=graft_tree_2, Unitize=False)  # -> Vector, Length; disabled
cull_pattern = CullPattern(List=simplify(vector_2pt.Vector), CullPattern=simplify(smaller_than.SmallerThan))  # disabled

# ----
polygon = Polygon(Plane=PlaneXY(0, 0, 0), Radius=Slider(19, range=0..100), Segments=Slider(20, range=0..100), FilletRadius=0)  # -> Polygon, Length
divide_curve = DivideCurve(Curve=curve_2, Count=Slider(1039, range=0..2000), Kinks=False)  # -> Points, Tangents, Parameters
discontinuity = Discontinuity(Curve=polygon.Polygon, Level=1)  # -> Points, Parameters
list_length = ListLength(List=discontinuity.Points)
area = Area(Geometry=polygon.Polygon)  # -> Area, Centroid
range = Range(Domain=Domain(0, 1), Steps=expr("x-1", list_length))
construct_domain_2 = ConstructDomain(DomainStart="1", DomainEnd=Slider(2, range=0..10))
graph_mapper = GraphMapper(range, x0=0, x1=1, y0=0, y1=1, container_name="Bezier", cpx=[0, 0, 1, 1], cpy=[0, 1, 1, 0])

# ---- group: Vector Strength
vector_length = VectorLength(Vector=cull_pattern)  # disabled
unit_vector = UnitVector(Vector=cull_pattern)  # disabled
bounds_2 = Bounds(Numbers=vector_length)  # disabled
deconstruct_domain = DeconstructDomain(Domain=bounds_2)  # -> Start, End; disabled
construct_domain_3 = ConstructDomain(DomainStart=deconstruct_domain.End, DomainEnd=deconstruct_domain.Start)  # disabled
remap_numbers_2 = RemapNumbers(Value=vector_length, Source=bounds_2, Target=construct_domain_3)  # -> Mapped, Clipped; disabled
number_slider_3 = Slider(0.5, range=0..10)  # disabled
multiplication = Multiplication(A=remap_numbers_2.Mapped, B=number_slider_3)  # disabled
amplitude = Amplitude(Vector=unit_vector, Amplitude=multiplication)  # disabled

# ----
remap_numbers_3 = RemapNumbers(Value=graph_mapper, Source=Domain(0, 1), Target=construct_domain_2)  # -> Mapped, Clipped
scale = Scale(Geometry=discontinuity.Points, Center=area.Centroid, Factor=remap_numbers_3.Mapped)  # -> Geometry, Transform
negative = Negative(Value=Slider(74, range=0..100))
mesh_brep = MeshBrep(
    Brep=surface,
    Settings={GridMaxCount=0, GridMinCount=16, JaggedSeams=False, MaxEdgeLength=0, MinEdgeLength=0.0001, MinTolerance=0, Refine=True, RefineAngle=0, RelativeTolerance=0.65, SimplePlanes=True, Tolerance=0})
multiplication_2 = Multiplication(A=graph_mapper, B=Slider(100, range=0..100))
nurbs_curve = NurbsCurve(Vertices=discontinuity.Points, Degree=3, Periodic=True)  # -> Curve, Length, Domain
unit_z = UnitZ(Factor=multiplication_2)
list_length_2 = ListLength(List=scale.Geometry)  # -> expr("x - 1", Length)
rotate = Rotate(Geometry=scale.Geometry, Angle=degrees(negative), Plane=area.Centroid)  # -> Geometry, Transform
list_item = ListItem(List=scale.Geometry, Index=["0", list_length_2], Wrap=True)  # -> flatten(Item)
replace_items = ReplaceItems(List=rotate.Geometry, Item=list_item, Indices=flatten(["0", list_length_2]), Wrap=False)
move = Move(Geometry=replace_items, Motion=unit_z)  # -> Geometry, Transform
shift_list = ShiftList(List=divide_curve.Points, Shift=1, Wrap=True)
nurbs_curve_2 = NurbsCurve(Vertices=move.Geometry, Degree=3, Periodic=True)  # -> Curve, Length, Domain
line = Line(StartPoint=divide_curve.Points, EndPoint=shift_list)
loft = Loft(
    Curves=flatten([nurbs_curve_2.Curve, nurbs_curve.Curve]),
    Options={Adjust=False, Closed=False, LoftEnds=0, LoftSimp=0, LoftType=0, Rebuild=10, Refit=0.01})

# ---- group: Insert Points for Growth
point_4 = Point(point)  # disabled
average = Average(Input=amplitude)  # disabled
graft_tree_3 = GraftTree(Tree=point_4, IncludeEmptyLists=True, IncludeNullItems=True)  # disabled
addition = Addition(A=graft_tree_3, B=average)  # -> flatten(Result); disabled
shift_list_2 = ShiftList(List=addition, Shift=1, Wrap=True)  # disabled
number_slider_4 = Slider(0.75, range=0..1)  # disabled
point_5 = Point(simplify(graft(shift_list_2)))  # disabled
point_6 = Point(simplify(graft(addition)))  # disabled
point_7 = Point(addition)  # disabled
distance_2 = Distance(PointA=point_6, PointB=point_5)  # disabled
average_2 = Average(Input=[point_6, point_5])  # -> flatten(ArithmeticMean); disabled
multiplication_3 = Multiplication(A=simplify_tree, B=number_slider_4)  # disabled
larger_than = LargerThan(FirstNumber=distance_2, SecondNumber=multiplication_3)  # -> flatten(LargerThan), OrEqualTo; disabled
list_length_3 = ListLength(List=flatten(distance_2))  # disabled
series = Series(Start=0, Step=1, Count=list_length_3)  # disabled
cull_pattern_2 = CullPattern(List=series, CullPattern=larger_than.LargerThan)  # disabled
list_item_2 = ListItem(List=average_2, Index=cull_pattern_2, Wrap=True)  # disabled
point_8 = Point(point_7)  # disabled
insert_items = InsertItems(List=point_8, Item=list_item_2, Indices=expr("x+1", cull_pattern_2), Wrap=True)  # -> flatten(List); disabled

# ----
map_to_surface = MapToSurface(Curve=line, Source=surface, Target=loft)
end_points = EndPoints(Curve=map_to_surface)  # -> Start, End
line_2 = Line(map_to_surface)
number_slider_5 = Slider(1.1, range=0..10)
line_3 = Line(line_2)
shift_list_3 = ShiftList(List=line_3, Shift=1, Wrap=True)
collider = Collider(Objects=line_2, Radii=number_slider_5, Strength=Slider(100, range=0..500))
angle = Angle(LineA=line_3, LineB=shift_list_3, RestAngle="0", Strength=Slider(1500, range=0..2000))
length_line = LengthLine(Line=line_2, Length=Slider(10, range=0..10), Strength=10)
onmesh = OnMesh(Points=end_points.End, Mesh=loft, Strength=Slider(1000, range=0..1000))
bouncysolver = BouncySolver(
    GoalObjects=flatten([onmesh, length_line, collider, angle]),
    Reset=Button(),
    Threshold=1e-15,
    Tolerance=0.01,
    Damping=Slider(1, range=0..1),
    Iterations=10,
    On=Toggle(False))  # -> I, V, O
nurbs_curve_3 = NurbsCurve(Vertices=bouncysolver.V, Degree=3, Periodic=True)  # -> Curve, Length, Domain
radia = Number(number_slider_5)

# ---- group: Restrict to mesh Brep
settings_quality = SettingsQuality()  # disabled
geometry = Geometry(<brep referenced from the Rhino model>)  # disabled
mesh_brep_2 = MeshBrep(Brep=geometry, Settings=settings_quality)  # disabled
mesh_closest_point = MeshClosestPoint(Point=insert_items, Mesh=mesh_brep_2)  # -> Point, Index, Parameter; disabled

# ----
pipe = Pipe(Curve=nurbs_curve_3.Curve, Radius=radia, Caps=0)
boolean_toggle_2 = BooleanToggle(True)  # disabled
loop_end = LoopEnd(
    port=loop_start.port,
    Exit=boolean_toggle,
    Data=mesh_closest_point.Point,
    TimeOutVal=0,
    pausedState=False,
    state="Constant output")  # disabled
polyline = PolyLine(Closed=invert(False))  # disabled
nurbs_curve_4 = NurbsCurve(Degree=3, Periodic=boolean_toggle_2)  # -> Curve, Length, Domain; disabled
