# Grasshopper definition BasicFields#1.gh (Grasshopper 1.0.7)
# plug-ins: EleFront

crv = Curve([<curve referenced from the Rhino model> x2])
divide = DivideCurve(Curve=crv, Count=Slider(10, range=0..10), Kinks=False)  # -> flatten(Points), Tangents, Parameters
polygon = Polygon(Plane=divide.Points, Radius=Slider(0.1, range=0..1), Segments="40", FilletRadius=0)  # -> Polygon, Length
pcharge = PointCharge(Point=divide.Points, Charge=Slider(0.5, range=0.1..1), Decay=Slider(3, range=0..10))
disc = Discontinuity(Curve=polygon.Polygon, Level=1)  # -> flatten(Points), Parameters
mergef = MergeFields(Fields=pcharge)
fline = FieldLine(Field=mergef, Point=disc.Points, Steps=1000, Accuracy=0.1, Method=3)
color = DefineColor(Color=ColourSwatch(SwatchColor=RGB(69, 211, 255)), Source="object")
crv_2 = Curve(fline)
attributes = DefineObjectAttributes(Color=color)
bake = BakeObjects(Geometry=crv_2, Attributes=attributes, Bake=False)
panel = Panel(bake)
