# Grasshopper definition MeshSubDiv#2.gh (Grasshopper 1.0.7)
# plug-ins: MeshEdit Components, Anemone, V-Ray For Grasshopper 6

mesh = Mesh(<mesh referenced from the Rhino model>)
tri = Triangulate(Mesh=mesh)  # -> Mesh, Count
mesh_2 = Mesh(<mesh referenced from the Rhino model>)  # disabled
loop_start = LoopStart(Repeat="3", Trigger=Button(), Data=tri.Mesh)  # -> port, Counter, Data
tri_2 = Triangulate(Mesh=mesh_2)  # -> Mesh, Count; disabled
explode = MeshExplode(Mesh=tri_2.Mesh, Interpolate=False)  # disabled
explode_2 = MeshExplode(Mesh=loop_start.Data, Interpolate=False)
number_slider = Slider(0.89, range=0..1)
demesh = DeconstructMesh(Mesh=explode_2)  # -> simplify(Vertices), Faces, Colours, Normals
facen = FaceNormals(Mesh=explode_2)  # -> simplify(Centers), Normals

# ---- group: AttPoint
pt = Point(<point referenced from the Rhino model>)
dist = Distance(PointA=facen.Normals, PointB=pt)
bnd = Bounds(Numbers=flatten(dist))
dom = ConstructDomain(DomainStart=Slider(-0.3, range=-1..5), DomainEnd=Slider(0.8, range=0..5))
remap = RemapNumbers(Value=dist, Source=bnd, Target=dom)  # -> simplify(Mapped), Clipped

# ----
facen_2 = FaceNormals(Mesh=explode)  # -> simplify(Centers), Normals; disabled

# ---- group: Att Point
number_slider_2 = Slider(-4.316, range=-5..5)  # disabled
number_slider_3 = Slider(4.347, range=-5..5)  # disabled
pt_2 = Point(<point referenced from the Rhino model>)  # disabled
dist_2 = Distance(PointA=facen_2.Normals, PointB=pt_2)  # disabled
bnd_2 = Bounds(Numbers=flatten(dist_2))  # disabled
dom_2 = ConstructDomain(DomainStart=number_slider_2, DomainEnd=number_slider_3)  # disabled
remap_2 = RemapNumbers(Value=dist_2, Source=bnd_2, Target=dom_2)  # -> Mapped, Clipped; disabled

# ----
faceb = FaceBoundaries(Mesh=explode)  # disabled
demesh_2 = DeconstructMesh(Mesh=explode)  # -> simplify(Vertices), Faces, Colours, Normals; disabled
amp = Amplitude(Vector=facen_2.Normals, Amplitude=remap_2.Mapped)  # disabled
amp_2 = Amplitude(Vector=facen.Normals, Amplitude=remap.Mapped)  # -> simplify(Vector)
move = Move(Geometry=facen.Centers, Motion=amp_2)  # -> simplify(Geometry), Transform
move_2 = Move(Geometry=facen_2.Centers, Motion=amp)  # -> simplify(Geometry), Transform; disabled
replace = ReplaceItems(List=demesh.Vertices, Item=move.Geometry, Indices=0, Wrap=False)
replace_2 = ReplaceItems(List=demesh.Vertices, Item=move.Geometry, Indices=1, Wrap=False)
replace_3 = ReplaceItems(List=demesh.Vertices, Item=move.Geometry, Indices=2, Wrap=False)
replace_4 = ReplaceItems(List=demesh_2.Vertices, Item=move_2.Geometry, Indices=0, Wrap=False)  # disabled
replace_5 = ReplaceItems(List=demesh_2.Vertices, Item=move_2.Geometry, Indices=1, Wrap=False)  # disabled
replace_6 = ReplaceItems(List=demesh_2.Vertices, Item=move_2.Geometry, Indices=2, Wrap=False)  # disabled
panel = Panel("Q{0;1;2}")  # disabled
conmesh = ConstructMesh(Vertices=replace, Faces="Q{0;1;2}")
conmesh_2 = ConstructMesh(Vertices=replace_2, Faces="Q{0;1;2}")
conmesh_3 = ConstructMesh(Vertices=replace_3, Faces="Q{0;1;2}")
conmesh_4 = ConstructMesh(Vertices=replace_4, Faces=panel)  # disabled
conmesh_5 = ConstructMesh(Vertices=replace_5, Faces=panel)  # disabled
conmesh_6 = ConstructMesh(Vertices=replace_6, Faces=panel)  # disabled
mjoin = MeshJoin(Meshes=flatten([conmesh, conmesh_2, conmesh_3]))
mjoin_2 = MeshJoin(Meshes=flatten([conmesh_4, conmesh_5, conmesh_6]))  # disabled
unifynormals = MeshUnifyNormals(Mesh=mjoin)
unifynormals_2 = MeshUnifyNormals(Mesh=mjoin_2)  # disabled
loop_end = LoopEnd(port=loop_start.port, Exit=Toggle(False), Data=unifynormals, TimeOutVal=0, pausedState=False, state="Constant output")
mtl_preset = VRayMaterialPreset(Preset=3, MaterialBaseColorOrTexture={AColor=RGB(212, 58, 138), FileName="", State=2})
mesh_3 = Mesh(loop_end)
vgeo = VRayGeometry(Geo=mesh_3, Material=mtl_preset)
out_img = OutputImage(
    "C:\Users\mail.DESKTOP-VS95QMN\Dropbox\08 CODE\Grasshopper\DifferentDesign\MeshSubdivision\test.png",
    File_Picker=1,
    File_Types="Portable Network Graphics (*.png)|*.png|Windows bitmap (*.bmp)|*.bmp|Targa Image (*.tga)|*.tga|Radiance High-Dynamyc Range (*.hdr)|*.hdr|Silicon Graphics (*.sgi; *.rgb; *.rgba)|*.dgi;*.rgb;*.rgba|JPEG image (*.jpg; *.jpeg)|*.jpg;*.jpeg|OpenEXR image (*.exr)|*.exr|SoftImage PICT (*.pic)|*.pic|Tagged image (*.tif; *.tiff)|*.tif;*.tiff|V-Ray Raw Image (*.vrimg)|*.vrimg",
    Multiple_Files=False)
engine = Engine(1, Has_Extract_Parameter=False, Has_Manage_Collection=False, OptionsLength=3, Version=1, Options=["CPU", "CUDA", "RTX"])
mode = Mode(
    0,
    Has_Extract_Parameter=False,
    Has_Manage_Collection=False,
    OptionsLength=2,
    Version=1,
    Options=["Interactive", "Production"])
sampler = Sampler(
    0,
    Has_Extract_Parameter=False,
    Has_Manage_Collection=False,
    OptionsLength=2,
    Version=1,
    Options=["Progressive", "Bucket"])
quality = Quality(
    2,
    Has_Extract_Parameter=False,
    Has_Manage_Collection=False,
    OptionsLength=6,
    Version=1,
    Options=["Low", "Low+", "Medium", "Medium+", "High", "High+"])
camera = VRayCamera(
    Position=Point(136.7948026, 5.166748218, 45.42041624),
    Target=Point(8.602058779, 30.31885563, 23.32440634),
    FOV=47.33911133,
    Tilt=8.537736463e-07,
    OrthographicZoomFactor=0,
    PhysicalExposureOn=False,
    FNumber=8,
    ShutterSpeed1S=100,
    FilmSensitivity=625)  # -> Camera, Angle
render = VRayRender(
    Engine=engine,
    Mode=mode,
    Sampler=sampler,
    Quality=quality,
    OutputImage=out_img,
    OutputResolution=[960, 540],
    Camera=camera.Camera,
    VGeometry=flatten(vgeo),
    UpdateEffectsFrequency=100)
