# Grasshopper definition 7.02_ParticleSystem.gh (Grasshopper 1.0.7)
# plug-ins: Anemone

pop2d = Populate2D(Region={Plane=PlaneXY(0, 0, 0), Size=Domain2(u=0..20, v=0..10)}, Count=100, Seed=1)
pt = Point(pop2d)
loop_start = LoopStart(Repeat=0)  # -> port, Counter, Data
loop_end = LoopEnd(port=loop_start.port, Exit=False, TimeOutVal=0, pausedState=False, state="Constant output")
