# Grasshopper definition KangarooFolding.gh (Grasshopper 1.0.7)
# plug-ins: Kangaroo2 Components

# ---- group: Kangaroo Controls
damping = Slider(0.949, range=0..1)
kangaroo_reset = Button()
kangaroo_on = BooleanToggle(True)

# ----
surface = Surface(<surface referenced from the Rhino model>)
radii = Slider(1.1, range=0..10)
curve_division = Slider(1073, range=0..2000)
line_length = Slider(10, range=0..10)
collider_strength = Slider(227, range=0..500)
angle_strength = Slider(1866, range=0..2000)
curve = Curve(<curve referenced from the Rhino model>)
mesh_brep = MeshBrep(
    Brep=surface,
    Settings={GridMaxCount=0, GridMinCount=16, JaggedSeams=False, MaxEdgeLength=0, MinEdgeLength=0.0001, MinTolerance=0, Refine=True, RefineAngle=0, RelativeTolerance=0.65, SimplePlanes=True, Tolerance=0})
divide_curve = DivideCurve(Curve=curve, Count=curve_division, Kinks=False)  # -> Points, Tangents, Parameters
onmesh = OnMesh(Points=divide_curve.Points, Mesh=mesh_brep, Strength=Slider(1000, range=0..1000))
radia = Number(radii)

# ---- group: Create lower res Curve
shift_list = ShiftList(List=divide_curve.Points, Shift=1, Wrap=True)
line = Line(StartPoint=divide_curve.Points, EndPoint=shift_list)

# ----
line_2 = Line(line)
line_3 = Line(line_2)
shift_list_2 = ShiftList(List=line_3, Shift=1, Wrap=True)
length_line = LengthLine(Line=line_2, Length=line_length, Strength=10)
collider = Collider(Objects=line_2, Radii=radii, Strength=collider_strength)
angle = Angle(LineA=line_3, LineB=shift_list_2, RestAngle="0", Strength=angle_strength)
bouncysolver = BouncySolver(
    GoalObjects=flatten([onmesh, length_line, collider, angle]),
    Reset=kangaroo_reset,
    Threshold=1e-15,
    Tolerance=0.01,
    Damping=damping,
    Iterations=10,
    On=kangaroo_on)  # -> I, V, O
nurbs_curve = NurbsCurve(Vertices=bouncysolver.V, Degree=3, Periodic=True)  # -> Curve, Length, Domain
pipe = Pipe(Curve=nurbs_curve.Curve, Radius=radia, Caps=0)
