# Grasshopper definition 2DSubdividion.gh (Grasshopper 1.0.7)
# plug-ins: Anemone

polygon = Polygon(Plane=PlaneXY(0, 0, 0), Radius=Slider(10, range=0..10), Segments=Slider(3, range=0..10), FilletRadius=0)  # -> Polygon, Length
crv = Curve(polygon.Polygon)
loop_start = LoopStart(Repeat=Slider(5, range=0..10), Trigger=Button(), Data=crv)  # -> port, Counter, Data
graft = GraftTree(Tree=loop_start.Data, IncludeEmptyLists=True, IncludeNullItems=True)  # -> simplify(Tree)
area = Area(Geometry=graft)  # -> Area, simplify(Centroid)
disc = Discontinuity(Curve=graft, Level=1)  # -> simplify(Points), Parameters
replace = ReplaceItems(List=disc.Points, Item=area.Centroid, Indices=0, Wrap=False)
replace_2 = ReplaceItems(List=disc.Points, Item=area.Centroid, Indices=2, Wrap=False)  # -> simplify(List)
replace_3 = ReplaceItems(List=disc.Points, Item=area.Centroid, Indices=1, Wrap=False)
pline = PolyLine(Vertices=replace, Closed=True)
pline_2 = PolyLine(Vertices=replace_2, Closed=True)
pline_3 = PolyLine(Vertices=replace_3, Closed=True)
crv_2 = Curve(flatten([pline_2, pline_3, pline]))
loop_end = LoopEnd(port=loop_start.port, Exit=Toggle(True), Data=crv_2, TimeOutVal=0, pausedState=False, state="Constant output")
crv_3 = Curve(loop_end)
preview = CustomPreview(Geometry=crv_3, Material=ColourSwatch(SwatchColor=RGB(255, 255, 255)))
