# Grasshopper definition MeshSubDiv#1.gh (Grasshopper 1.0.7)
# plug-ins: MeshEdit Components, Pufferfish

number_slider = Slider(2, range=0..10)
mbox = MeshBox(
    Base={Plane=PlaneXY(0, 0, 0), X=Domain(-10, 10), Y=Domain(-10, 10), Z=Domain(-10, 10)},
    XCount=number_slider,
    YCount=number_slider,
    ZCount=number_slider)
panel = Panel("""0
2
6
8
9
11
15
17""")
weldvertices = MeshWeldVertices(Mesh=mbox, Tolerance=0.01)  # -> RuntimeMessage, Mesh
faceb = FaceBoundaries(Mesh=weldvertices.Mesh)
demesh = DeconstructMesh(Mesh=weldvertices.Mesh)  # -> Vertices, Faces, Colours, Normals
volume = MeshVolume(Mesh=mbox)  # -> Volume, Centroid
item = ListItem(List=demesh.Vertices, Index=panel, Wrap=True)
vec2pt = Vector2Pt(PointA=item, PointB=volume.Centroid, Unitize=False)  # -> Vector, Length
amp = Amplitude(Vector=vec2pt.Vector, Amplitude=Slider(10, range=-10..10))
move = Move(Geometry=item, Motion=amp)  # -> Geometry, Transform
replace = ReplaceItems(List=demesh.Vertices, Item=move.Geometry, Indices=panel, Wrap=False)
conmesh = ConstructMesh(Vertices=replace, Faces=demesh.Faces)
pt = ConstructPoint(XCoordinate=0, YCoordinate=0, ZCoordinate=Slider(7, range=0..30))
faceb_2 = FaceBoundaries(Mesh=conmesh)
xy = XYPlane(Origin=pt)
mircutmsh = MirrorCutMesh(
    Mesh=conmesh,
    MirrorPlane=xy,
    Reach=0,
    Offset=0,
    Flip=True,
    Join=True,
    Keep=False,
    ConnectionType=2,
    Bulge=-0.5,
    Divisions=1,
    WeldVertices=0.01)  # -> MirrorCut, SplitIndex, ReachPlane, OffsetPlane, Intersected
vec = VectorXYZ(XComponent=Slider(8, range=0..10), YComponent=Slider(10, range=0..10), ZComponent=Slider(6, range=0..10))  # -> Vector, Length
pl = PlaneNormal(Origin=Point(0, 0, 0), ZAxis=vec.Vector)
vdis = VectorDisplay(Anchor=Point(0, 0, 0), Vector=vec.Vector)
mircutmsh_2 = MirrorCutMesh(
    Mesh=mircutmsh.MirrorCut,
    MirrorPlane=pl,
    Reach=0,
    Offset=0,
    Flip=False,
    Join=True,
    Keep=False,
    ConnectionType=2,
    Bulge=-0.5,
    Divisions=1,
    WeldVertices=0.01)  # -> MirrorCut, SplitIndex, ReachPlane, OffsetPlane, Intersected
pt_2 = ConstructPoint(XCoordinate=0, YCoordinate=0, ZCoordinate=Slider(22, range=0..30))
xy_2 = XYPlane(Origin=pt_2)
mircutmsh_3 = MirrorCutMesh(
    Mesh=mircutmsh_2.MirrorCut,
    MirrorPlane=xy_2,
    Reach=0,
    Offset=0,
    Flip=True,
    Join=True,
    Keep=False,
    ConnectionType=2,
    Bulge=-0.5,
    Divisions=1,
    WeldVertices=0.01)  # -> MirrorCut, SplitIndex, ReachPlane, OffsetPlane, Intersected
mesh = Mesh(mircutmsh_3.MirrorCut)
weld = WeldMesh(Mesh=mesh, Angle=3.141592654)
preview = CustomPreview(Geometry=weld, Material=ColourSwatch(SwatchColor=RGB(255, 255, 255)))
