# Grasshopper definition 3.01_KangarooMeshRelax.gh (Grasshopper 1.0.7)
# plug-ins: MeshEdit Components, Kangaroo2 Components, Mesh Pipe

mesh = Mesh(<mesh referenced from the Rhino model>)
weldvertices = MeshWeldVertices(Mesh=mesh, Tolerance=0.01)  # -> RuntimeMessage, Mesh
msmooth = SmoothMesh(Mesh=weldvertices.Mesh, Strength=Slider(1, range=0..1), SkipNaked=invert(True), Iterations=Slider(80, range=0..100))
show = Show(G=msmooth)
nv = NakedVertices(Mesh=msmooth)  # -> ClothedIndex, NakedIndex, ClothedPts, NakedPts
edgelengths = EdgeLengths(Mesh=msmooth, LengthFactor=Slider(0.48, range=0..1), Strength=1)
anchor = Anchor(Point=nv.NakedPts, Strength=10000)
bouncysolver = BouncySolver(
    GoalObjects=[show, edgelengths, anchor],
    Reset=Button(),
    Threshold=1e-15,
    Tolerance=0.01,
    Damping=0.99,
    Iterations=10,
    On=Toggle(False))  # -> I, V, O
item = ListItem(List=bouncysolver.O, Index=0, Wrap=True)
mesh_2 = Mesh(item)
faceb = FaceBoundaries(Mesh=mesh_2)
m_midedge = MidEdgeSubdivision(P=faceb, L=1, E=2, S=0.01)  # -> out, VP, FP, M; inputs P: list of Polyline; disabled
#   port E: 0 = Fixed Vertices 1 = Fixed Corners 2 = Remove Naked Corners 3 = Remove Naked
# ---------- m_midedge: VB ----------
    Component.Params.Input(0).Name = "Polylines"
    Component.Params.Input(0).Description = "A list of closed polylines with three or more edges"
    Component.Params.Input(1).Name = "Loops"
    Component.Params.Input(1).Description = "The number of iterations"
    Component.Params.Input(2).Name = "Edge Type"
    Component.Params.Input(2).Description = " 0 = Fixed Vertices" & VBCRLF & " 1 = Fixed Corners" & VBCRLF & " 2 = Remove Naked Corners" & VBCRLF & " 3 = Remove Naked"
    Component.Params.Input(3).Name = "Simplify"
    Component.Params.Input(3).Description = "If true vertices added at co linear midpoints will be removed."

    Component.Params.Output(1).Name = "Vertex Polygons"
    Component.Params.Output(1).Description = "New polygons created about the vertices"
    Component.Params.Output(2).Name = "Face Polygons"
    Component.Params.Output(2).Description = "The polygons replacing the faces"
    Component.Params.Output(3).Name = "Preview Mesh"
    Component.Params.Output(3).Description = "A triangulated preview mesh"


    If ((P.count() > 0) And (L > 0)) Then
      Dim iP As Grasshopper.Kernel.IGH_Param = Component.Params.Input(0)
      Dim cP As Grasshopper.Kernel.Data.IGH_Structure = iP.VolatileData

      Dim j,W As Integer
      Dim pt,pv,pf As New list(Of polyline)

      For j = 0 To p.count() - 1 Step 1
        If ((p.item(j).count() > 3) Or (p.item(j).isclosed())) Then
          pt.add(p.item(j))
        End If
      Next

      p = pt
      For W = 0 To (L - 1) Step 1
        Dim k,u(),r,t,x,y,z,ei,pi As Integer
        Dim mo As New mesh
        Dim arrM As New list(Of mesh)
        Dim VertexNormals As New list(Of vector3d)
        Dim FaceNormals As New datatree(Of Vector3d)
        Dim Vertices As New list(Of point3d)
        Dim FaceCenters As New datatree(Of Point3d)
        Dim TopologyEdges As New list(Of Interval)
        Dim NakedVertexStatus,NakedEdgeStatus As New list(Of Boolean)
        Dim arrN() As Boolean
        Dim arrPline,arrPv,arrPf As New list(Of Polyline)
        Dim blnX As New Boolean

        Dim TopologyFaces,VertConnectedFaces,EdgeConnectedFaces,FaceEdges,VertConnectedVertices,VertConnectedEdges,FaceConnectedFaces As New datatree(Of Integer)

        z = 0
        For k = 0 To P.count() - 1 Step 1
          Dim Q As New mesh
          Dim mf As New list(Of meshface)
          Dim I As polyline
          I = P(k)

          Dim tm As New mesh
          Dim cpt As point3d
          tm.Vertices.AddVertices(I)
          tm.Faces.AddFaces(I.TriangulateClosedPolyline())
          cpt = Rhino.Geometry.AreaMassProperties.Compute(tm).Centroid()

          Q.Vertices.Add(cpt)
          FaceCenters.add(cpt, New GH_Path(k))
          I.RemoveAt(I.Count() - 1)

          Q.Vertices.AddVertices(I)
          u = append(I.count() - 1)
          For j = 0 To I.count() - 1 Step 1
            mf.add(New meshface(u(j) + 1, u(j + 1) + 1, 0))
          Next

          Q.Faces.AddFaces(mf)

          Q.FaceNormals.ComputeFaceNormals()
          Q.Normals.ComputeNormals()

          FaceNormals.add(Q.Normals(0), New GH_Path(k))
          arrM.add(Q)

          If k = 0 Then mo = Q.Duplicate Else mo.Append(Q)
        Next

        mo.Weld(math.PI)

        Dim tcl  As New pointcloud
        Dim tpt As New list(Of point3d)
        Dim ser As New list(Of Integer)
        tcl.AddRange(mo.Vertices.ToPoint3dArray())
        tpt = mo.Vertices.ToPoint3dArray().ToList()
        ser = series(tpt.count() - 1)

        For k = 0 To mo.Vertices.Count() - 2 Step 1
          tcl.RemoveAt(0)
          tpt.removeAt(0)
          ser.removeat(0)
          j = tcl.ClosestPoint(mo.Vertices(k))
          If New point3d(mo.Vertices(k)).distanceto(tpt(j)) < 0 Then
            mo.Vertices.SetVertex(k, mo.Vertices(ser(j)))
          End If
        Next

        mo.Weld(math.PI)
        mo.Vertices.CullUnused()
        arrN = mo.GetNakedEdgePointStatus()

        mo.FaceNormals.ComputeFaceNormals()
        mo.Normals.ComputeNormals()
        mo.UnifyNormals()

        Dim pcl As New pointcloud
        pcl.AddRange(mo.Vertices.ToPoint3dArray())
        Dim ic As New dictionary(Of Integer, Integer)
        Dim ec,efc,evc,vfi,eef,eev,vfee As New dictionary(Of String, Integer)
        Dim vfes As New dictionary(Of String, Interval)
        Dim mte As Rhino.Geometry.Collections.MeshTopologyEdgeList
        Dim mtv As Rhino.Geometry.Collections.MeshTopologyVertexList
        Dim nakedInd As New datatree(Of Integer)


        mte = mo.TopologyEdges
        mtv = mo.TopologyVertices

        z = 0
        For k = 0 To P.count() - 1 Step 1

          Dim I As polyline
          I = P(k)

          Dim nkfc As New Boolean

          X = pcl.ClosestPoint(I(0))
          If Not ic.containskey(x) Then
            Vertices.add(mo.Vertices(x))
            VertexNormals.add(mo.Normals(x))
            NakedVertexStatus.add(arrN(X))
            nakedInd.ensurepath(z)
            ic.add(x, z)
            z += 1
          End If
          r = x
          TopologyFaces.add(ic.item(x), cp.path(Component.RunCount - 1).AppendElement(k))
          VertConnectedFaces.add(k, New gh_path(ic.item(x)))

          vfi.add(ic.item(x) & "_" & k, 0)

          Dim fpline,npline As New polyline
          For j = 1 To I.count() - 1 Step 1
            y = pcl.ClosestPoint(I(j))
            If Not ic.containskey(y) Then
              Vertices.add(mo.Vertices(y))
              VertexNormals.add(mo.Normals(y))
              NakedVertexStatus.add(arrN(Y))
              nakedInd.ensurepath(z)
              ic.add(y, z)
              z += 1
            End If

            vfi.add(ic.item(y) & "_" & k, j)
            TopologyFaces.add(ic.item(y), cp.path(Component.RunCount - 1).AppendElement(k))
            VertConnectedFaces.add(k, New gh_path(ic.item(y)))

            If Not ec.containskey(CStr(ic.item(x) & "_" & ic.item(y))) Then
              ec.add(CStr(ic.item(x) & "_" & ic.item(y)), TopologyEdges.count())
              ec.add(CStr(ic.item(y) & "_" & ic.item(x)), TopologyEdges.count())

              VertConnectedEdges.add(TopologyEdges.count(), New gh_path(ic.item(x)))
              VertConnectedEdges.add(TopologyEdges.count(), New gh_path(ic.item(y)))

              VertConnectedVertices.add(ic.item(y), New gh_path(ic.item(x)))
              VertConnectedVertices.add(ic.item(x), New gh_path(ic.item(y)))

              TopologyEdges.add(New interval(ic.item(x), ic.item(y)))
              NakedEdgeStatus.add(mte.GetConnectedFaces(mte.GetEdgeIndex(mtv.TopologyVertexIndex(x), mtv.TopologyVertexIndex(y))).ToList().count() = 1)

              If NakedEdgeStatus.item(NakedEdgeStatus.count() - 1) Then
                nakedInd.add(ic.item(y), New gh_path(ic.item(x)))
                nakedInd.add(ic.item(x), New gh_path(ic.item(y)))
              End If
            End If
            ei = ec.item(CStr(ic.item(x) & "_" & ic.item(y)))

            EdgeConnectedFaces.add(k, New gh_path(ei))
            FaceEdges.add(ei, New gh_path(k))

            fpline.add((vertices(ic.item(x)) + vertices(ic.item(y))) / 2)
            If Not NakedEdgeStatus(ei) Then
              nkfc = True
              npline.add(fpline.item(fpline.count() - 1))
            End If

            If j > 1 Then
              vfes.add(ic.item(x) & "_" & k, New interval(pi, ei))
              vfee.add(ic.item(x) & "_" & k & "_" & pi, ei)
              vfee.add(ic.item(x) & "_" & k & "_" & ei, pi)
              eef.add(pi & "_" & ei, k)
              eef.add(ei & "_" & pi, k)
              eev.add(pi & "_" & ei, ic.item(x))
              eev.add(ei & "_" & pi, ic.item(x))
            Else
              t = ei
            End If
            pi = ei
            x = y
          Next

          If Not ec.containskey(CStr(ic.item(x) & "_" & ic.item(r))) Then
            ec.add(CStr(ic.item(r) & "_" & ic.item(x)), TopologyEdges.count())
            ec.add(CStr(ic.item(x) & "_" & ic.item(r)), TopologyEdges.count())

            VertConnectedEdges.add(TopologyEdges.count(), New gh_path(ic.item(x)))
            VertConnectedEdges.add(TopologyEdges.count(), New gh_path(ic.item(r)))

            VertConnectedVertices.add(ic.item(r), New gh_path(ic.item(x)))
            VertConnectedVertices.add(ic.item(x), New gh_path(ic.item(r)))

            TopologyEdges.add(New interval(ic.item(x), ic.item(r)))
            NakedEdgeStatus.add(mte.GetConnectedFaces(mte.GetEdgeIndex(mtv.TopologyVertexIndex(x), mtv.TopologyVertexIndex(r))).ToList().count() = 1)

            If NakedEdgeStatus.item(NakedEdgeStatus.count() - 1) Then
              nakedInd.add(ic.item(r), New gh_path(ic.item(x)))
              nakedInd.add(ic.item(x), New gh_path(ic.item(r)))
            End If
          End If
          ei = ec.item(CStr(ic.item(x) & "_" & ic.item(r)))
          If NakedEdgeStatus(ei) Then nkfc = True

          EdgeConnectedFaces.add(k, New gh_path(ei))
          FaceEdges.add(ei, New gh_path(k))

          fpline.add((vertices(ic.item(x)) + vertices(ic.item(r))) / 2)
          If Not NakedEdgeStatus(ei) Then
            nkfc = True
            npline.add(fpline.item(fpline.count() - 1))
          End If

          If fpline.count() > 2 Then
            fpline.add(fpline(0))

            If ((e <> 3) Or ((e = 3) And (Not nkfc))) Then
              arrPline.add(fpline)
              arrPf.add(fpline)
            ElseIf npline.count() > 2 Then
              npline.add(npline(0))
              arrPline.add(npline)
              arrPf.add(npline)
            End If
          End If
          vfes.add(ic.item(x) & "_" & k, New interval(ei, pi))
          vfee.add(ic.item(x) & "_" & k & "_" & ei, pi)
          vfee.add(ic.item(x) & "_" & k & "_" & pi, ei)
          eef.add(pi & "_" & ei, k)
          eef.add(ei & "_" & pi, k)
          eev.add(pi & "_" & ei, ic.item(x))
          eev.add(ei & "_" & pi, ic.item(x))

          vfes.add(ic.item(r) & "_" & k, New interval(t, ei))
          vfee.add(ic.item(r) & "_" & k & "_" & t, ei)
          vfee.add(ic.item(r) & "_" & k & "_" & ei, t)
          eef.add(t & "_" & ei, k)
          eef.add(ei & "_" & t, k)
          eev.add(t & "_" & ei, ic.item(r))
          eev.add(ei & "_" & t, ic.item(r))

        Next

        For j = 0 To EdgeConnectedFaces.branchcount() - 1 Step 1
          If EdgeConnectedFaces.branch(j).count() > 1 Then
            FaceConnectedFaces.add(EdgeConnectedFaces.branch(j).item(0), New gh_path(EdgeConnectedFaces.branch(j).item(1)))
            FaceConnectedFaces.add(EdgeConnectedFaces.branch(j).item(1), New gh_path(EdgeConnectedFaces.branch(j).item(0)))

            efc.add(j & "_" & EdgeConnectedFaces.branch(j).item(0), EdgeConnectedFaces.branch(j).item(1))
            efc.add(j & "_" & EdgeConnectedFaces.branch(j).item(1), EdgeConnectedFaces.branch(j).item(0))

          End If
          evc.add(j & "_" & TopologyEdges.item(j).t0, TopologyEdges.item(j).t1)
          evc.add(j & "_" & TopologyEdges.item(j).t1, TopologyEdges.item(j).t0)
        Next

        Dim srtE, srtF,srtV As New datatree(Of Integer)
        Dim Ed,f,v,ex As Integer

        If e < 3 Then ex = 1 Else ex = 2

        For j = 0 To Vertices.count() - 1 Step 1
          Dim pline As New polyline
          x = 0
          If  (((e = 2) And vertconnectedvertices.branch(j).count() > 2) Or (e <> 2))Then
            If ((VertConnectedEdges.branch(j).count() > ex) And (((e = 3) And (Not NakedVertexStatus(j))) Or (e <> 3))) Then

              Dim cullList As New list(Of Integer)
              cullList = nakedInd.branch(j)

              If nakedInd.branch(j).count() > 0 Then
                Ed = ec.item(cullList(0) & "_" & j)
                cullList.removeat(0)
                If ((e = 2) Or (e = 0) Or ((e = 1) And vertconnectedvertices.branch(j).count() < 3)) Then pline.add(vertices(j))
              Else
                Ed = VertConnectedEdges.branch(j).item(0)
              End If

              f = EdgeConnectedFaces.branch(Ed).item(0)
              v = evc.item(Ed & "_" & j)
              srtV.add(v, New gh_path(j, x))
              pline.Add((vertices(v) + vertices(j)) / 2)

              For k = 1 To VertConnectedEdges.branch(j).count() - 1 Step 1
                Ed = vfee(j & "_" & f & "_" & Ed)
                v = evc.item(Ed & "_" & j)
                If NakedEdgeStatus(Ed) Then

                  srtV.add(v, New gh_path(j, x))
                  pline.Add((vertices(v) + vertices(j)) / 2)

                  k += 1
                  If k > VertConnectedEdges.branch(j).count() - 1 Then Exit For
                  cullList.remove(v)
                  Ed = ec.item(cullList(0) & "_" & j)
                  v = evc.item(Ed & "_" & j)
                  f = EdgeConnectedFaces.branch(Ed).item(0)
                  x += 1
                Else
                  f = efc(Ed & "_" & f)
                End If
                srtV.add(v, New gh_path(j, x))
                pline.Add((vertices(v) + vertices(j)) / 2)
              Next

              If pline.count() > 2 Then
                pline.Add(pline(0))

                If S > 0 Then pline = simplePoly(pline, s)
                arrPline.add(pline)
                arrPv.add(pline)
              End If
            End If
          End If
        Next
        P = arrPline
        pv = arrPv
        pf = arrPf
      Next

      Dim mxo As New mesh
      Dim mt As New list(Of mesh)
      For j = 0 To P.count() - 1 Step 1
        Dim mx As New mesh
        mx.Vertices.AddVertices(p(j))
        If p(j).count() > 5 Then
          mx.faces.addfaces(p.item(j).TriangulateClosedPolyline())
        ElseIf p(j).count() = 5 Then
          mx.Faces.AddFace(New meshface(0, 1, 2, 3))
        Else
          mx.Faces.AddFace(New meshface(0, 1, 2))
        End If
        mxo.Append(mx)
      Next
      mxo.Weld(math.pi)
      mxo.UnifyNormals()
      mxo.FaceNormals.ComputeFaceNormals()
      mxo.Normals.ComputeNormals()

      VP = pv
      FP = pf
      M = mxo
    End If
# ---------- m_midedge: VB additional code ----------
  Private Function simplePoly(ByVal p As polyline, ByVal s As Double)
    If vector3d.VectorAngle(New vector3d(p(0) - p(1)), New vector3d(p(p.count() - 2) - p(0))) < math.pi * (S / 180) Then
      p.RemoveAt(0)
      p.RemoveAt(p.Count() - 1)
      p.add(p(0))
    End If
    Return p
  End Function

  Private Function append(ByVal j As Integer)
    Dim srsEnum As IEnumerable(Of Integer) = Enumerable.Range(0, j + 1)
    Dim arrVal As New list(Of Integer)
    arrVal = srsEnum.tolist()
    arrVal.add(0)
    Return arrVal.toarray()
  End Function

  Private Function series(ByVal j As Integer)
    Dim srsEnum As IEnumerable(Of Integer) = Enumerable.Range(0, j)
    Dim arrVal As New list(Of Integer)
    arrVal = srsEnum.tolist()
    Return arrVal
  End Function
# ---------- end m_midedge ----------
m_modkobbelt = ModifiedKobbeltSubdivision(P=faceb, L=1, E=1)  # -> out, VP, M; inputs P: list of Polyline, T: list
#   port E: 0 = Fixed Vertices 1 = About Naked (Smooth) 2 = Remove Naked
# ---------- m_modkobbelt: VB ----------
    Component.Params.Input(0).Name = "Polylines"
    Component.Params.Input(0).Description = "A list of closed polylines with three or more edges"
    Component.Params.Input(1).Name = "Loops"
    Component.Params.Input(1).Description = "The number of iterations"
    Component.Params.Input(2).Name = "Edge Type"
    Component.Params.Input(2).Description = " 0 = Fixed Vertices" & VBCRLF & " 1 = About Naked (Smooth)" & VBCRLF & " 2 = Remove Naked"
    Component.Params.Input(3).Name = "Multiplier"
    Component.Params.Input(3).Description = "An optional list of unitized numbers from the MapToCrv component which specify the multiplier for smoothing"

    Component.Params.Output(1).Name = "Vertex Polygons"
    Component.Params.Output(1).Description = "New polygons created about the vertices"
    Component.Params.Output(2).Name = "Preview Mesh"
    Component.Params.Output(2).Description = "A triangulated preview mesh"

    If ((P.count() > 0) And (L > 0)) Then
      Dim iP As Grasshopper.Kernel.IGH_Param = Component.Params.Input(0)
      Dim cP As Grasshopper.Kernel.Data.IGH_Structure = iP.VolatileData

      Dim j,s As Integer
      Dim pt,pv,pf As New list(Of polyline)
      Dim B As New list(Of dictionary(Of Integer,Object))

      Dim tdic As New dictionary(Of Integer,Object)
      tdic.add(0, 1)

      For j = 0 To p.count() - 1 Step 1
        If ((p.item(j).count() > 3) Or (p.item(j).isclosed())) Then
          pt.add(p.item(j))
          t.add(tdic)
          If t.item(j).count() <> p.item(j).count() Then t.item(j) = dblmatch(t.item(j), p.item(j).count() - 1)
          B.add(t.item(j))
        End If
      Next

      p = pt
      For s = 0 To (L - 1) Step 1
        Dim k,u(),r,W,x,y,z,ei,pi As Integer
        Dim mo As New mesh
        Dim arrM As New list(Of mesh)
        Dim VertexNormals As New list(Of vector3d)
        Dim FaceNormals As New datatree(Of Vector3d)
        Dim Vertices As New list(Of point3d)
        Dim FaceCenters As New datatree(Of Point3d)
        Dim TopologyEdges As New list(Of Interval)
        Dim NakedVertexStatus,NakedEdgeStatus As New list(Of Boolean)
        Dim arrN() As Boolean
        Dim arrPline As New list(Of Polyline)
        Dim aft As New list(Of Double)
        Dim tt As New list(Of dictionary(Of Integer,Object))

        Dim TopologyFaces,VertConnectedFaces,EdgeConnectedFaces,FaceEdges,VertConnectedVertices,VertConnectedEdges,FaceConnectedFaces As New datatree(Of Integer)
        For k = 0 To P.count() - 1 Step 1
          Dim Q As New mesh
          Dim mf As New list(Of meshface)
          Dim I As polyline
          I = P(k)

          Dim tm As New mesh
          Dim cpt As point3d
          tm.Vertices.AddVertices(I)
          tm.Faces.AddFaces(I.TriangulateClosedPolyline())
          cpt = Rhino.Geometry.AreaMassProperties.Compute(tm).Centroid()

          Q.Vertices.Add(cpt)
          FaceCenters.add(cpt, New GH_Path(k))
          I.RemoveAt(I.Count() - 1)

          Q.Vertices.AddVertices(I)
          u = append(I.count() - 1)
          For j = 0 To I.count() - 1 Step 1
            mf.add(New meshface(u(j) + 1, u(j + 1) + 1, 0))
          Next

          Q.Faces.AddFaces(mf)

          Q.FaceNormals.ComputeFaceNormals()
          Q.Normals.ComputeNormals()

          FaceNormals.add(Q.Normals(0), New GH_Path(k))
          arrM.add(Q)

          If k = 0 Then mo = Q.Duplicate Else mo.Append(Q)

        Next

        mo.Weld(math.PI)

        Dim tcl  As New pointcloud
        Dim tpt As New list(Of point3d)
        Dim ser As New list(Of Integer)
        tcl.AddRange(mo.Vertices.ToPoint3dArray())
        tpt = mo.Vertices.ToPoint3dArray().ToList()
        ser = series(tpt.count() - 1)

        For k = 0 To mo.Vertices.Count() - 2 Step 1
          tcl.RemoveAt(0)
          tpt.removeAt(0)
          ser.removeat(0)
          j = tcl.ClosestPoint(mo.Vertices(k))
          If New point3d(mo.Vertices(k)).distanceto(tpt(j)) < 0 Then
            mo.Vertices.SetVertex(k, mo.Vertices(ser(j)))
          End If
        Next

        mo.Weld(math.PI)
        mo.Vertices.CullUnused()

        arrN = mo.GetNakedEdgePointStatus()

        mo.FaceNormals.ComputeFaceNormals()
        mo.Normals.ComputeNormals()
        mo.UnifyNormals()

        Dim pcl As New pointcloud
        pcl.AddRange(mo.Vertices.ToPoint3dArray())
        Dim ic As New dictionary(Of Integer, Integer)
        Dim ec,efc,evc,vfi,eef,eev,vfee As New dictionary(Of String, Integer)
        Dim vfes As New dictionary(Of String, Interval)
        Dim mte As Rhino.Geometry.Collections.MeshTopologyEdgeList
        Dim mtv As Rhino.Geometry.Collections.MeshTopologyVertexList
        Dim nakedInd As New datatree(Of Integer)
        Dim offsetVert() As Point3d
        Dim st As New list(Of Double)
        mte = mo.TopologyEdges
        mtv = mo.TopologyVertices

        ReDim offsetVert(mtv.Count() - 1)
        z = 0
        For k = 0 To P.count() - 1 Step 1

          Dim I As polyline
          I = P(k)

          Dim pft As New Double

          X = pcl.ClosestPoint(I(0))
          If Not ic.containskey(x) Then
            Vertices.add(mo.Vertices(x))
            VertexNormals.add(mo.Normals(x))
            NakedVertexStatus.add(arrN(x))
            nakedInd.ensurepath(z)
            ic.add(x, z)
            st.add(0)
            z += 1
          End If
          r = x
          TopologyFaces.add(ic.item(x), cp.path(Component.RunCount - 1).AppendElement(k))
          VertConnectedFaces.add(k, New gh_path(ic.item(x)))

          vfi.add(ic.item(x) & "_" & k, 0)
          st.item(ic.item(x)) += B.item(k).item(0)
          pft += B.item(k).item(0)

          For j = 1 To I.count() - 1 Step 1
            y = pcl.ClosestPoint(I(j))
            If Not ic.containskey(y) Then
              Vertices.add(mo.Vertices(y))
              VertexNormals.add(mo.Normals(y))
              NakedVertexStatus.add(arrN(y))
              nakedInd.ensurepath(z)
              ic.add(y, z)
              st.add(0)
              z += 1
            End If

            vfi.add(ic.item(y) & "_" & k, j)
            st.item(ic.item(y)) += B.item(k).item(j)
            pft += B.item(k).item(j)
            TopologyFaces.add(ic.item(y), cp.path(Component.RunCount - 1).AppendElement(k))
            VertConnectedFaces.add(k, New gh_path(ic.item(y)))

            If Not ec.containskey(CStr(ic.item(x) & "_" & ic.item(y))) Then
              ec.add(CStr(ic.item(x) & "_" & ic.item(y)), TopologyEdges.count())
              ec.add(CStr(ic.item(y) & "_" & ic.item(x)), TopologyEdges.count())

              VertConnectedEdges.add(TopologyEdges.count(), New gh_path(ic.item(x)))
              VertConnectedEdges.add(TopologyEdges.count(), New gh_path(ic.item(y)))

              VertConnectedVertices.add(ic.item(y), New gh_path(ic.item(x)))
              VertConnectedVertices.add(ic.item(x), New gh_path(ic.item(y)))

              offsetVert(ic.item(x)) += vertices(ic(y))
              offsetVert(ic.item(y)) += vertices(ic(x))

              TopologyEdges.add(New interval(ic.item(x), ic.item(y)))
              NakedEdgeStatus.add(mte.GetConnectedFaces(mte.GetEdgeIndex(mtv.TopologyVertexIndex(x), mtv.TopologyVertexIndex(y))).ToList().count() = 1)

              If NakedEdgeStatus.item(NakedEdgeStatus.count() - 1) Then
                nakedInd.add(ic.item(y), New gh_path(ic.item(x)))
                nakedInd.add(ic.item(x), New gh_path(ic.item(y)))
              End If
            End If
            ei = ec.item(CStr(ic.item(x) & "_" & ic.item(y)))
            EdgeConnectedFaces.add(k, New gh_path(ei))
            FaceEdges.add(ei, New gh_path(k))

            If j > 1 Then
              vfes.add(ic.item(x) & "_" & k, New interval(pi, ei))
              vfee.add(ic.item(x) & "_" & k & "_" & pi, ei)
              vfee.add(ic.item(x) & "_" & k & "_" & ei, pi)
              eef.add(pi & "_" & ei, k)
              eef.add(ei & "_" & pi, k)
              eev.add(pi & "_" & ei, ic.item(x))
              eev.add(ei & "_" & pi, ic.item(x))
            Else
              W = ei
            End If
            pi = ei
            x = y
          Next

          If Not ec.containskey(CStr(ic.item(x) & "_" & ic.item(r))) Then
            ec.add(CStr(ic.item(r) & "_" & ic.item(x)), TopologyEdges.count())
            ec.add(CStr(ic.item(x) & "_" & ic.item(r)), TopologyEdges.count())

            VertConnectedEdges.add(TopologyEdges.count(), New gh_path(ic.item(x)))
            VertConnectedEdges.add(TopologyEdges.count(), New gh_path(ic.item(r)))

            VertConnectedVertices.add(ic.item(r), New gh_path(ic.item(x)))
            VertConnectedVertices.add(ic.item(x), New gh_path(ic.item(r)))

            offsetVert(ic.item(r)) += vertices(ic(x))
            offsetVert(ic.item(x)) += vertices(ic(r))

            TopologyEdges.add(New interval(ic.item(x), ic.item(r)))
            NakedEdgeStatus.add(mte.GetConnectedFaces(mte.GetEdgeIndex(mtv.TopologyVertexIndex(x), mtv.TopologyVertexIndex(r))).ToList().count() = 1)

            If NakedEdgeStatus.item(NakedEdgeStatus.count() - 1) Then
              nakedInd.add(ic.item(r), New gh_path(ic.item(x)))
              nakedInd.add(ic.item(x), New gh_path(ic.item(r)))
            End If
          End If
          ei = ec.item(CStr(ic.item(x) & "_" & ic.item(r)))
          EdgeConnectedFaces.add(k, New gh_path(ei))
          FaceEdges.add(ei, New gh_path(k))

          vfes.add(ic.item(x) & "_" & k, New interval(ei, pi))
          vfee.add(ic.item(x) & "_" & k & "_" & ei, pi)
          vfee.add(ic.item(x) & "_" & k & "_" & pi, ei)
          eef.add(pi & "_" & ei, k)
          eef.add(ei & "_" & pi, k)
          eev.add(pi & "_" & ei, ic.item(x))
          eev.add(ei & "_" & pi, ic.item(x))

          vfes.add(ic.item(r) & "_" & k, New interval(W, ei))
          vfee.add(ic.item(r) & "_" & k & "_" & W, ei)
          vfee.add(ic.item(r) & "_" & k & "_" & ei, W)
          eef.add(W & "_" & ei, k)
          eef.add(ei & "_" & W, k)
          eev.add(W & "_" & ei, ic.item(r))
          eev.add(ei & "_" & W, ic.item(r))
          aft.add(pft / I.count())

        Next

        For j = 0 To EdgeConnectedFaces.branchcount() - 1 Step 1
          Dim epline As New polyline(0)
          Dim tda As New dictionary(Of Integer,Object)
          Dim cc,xt0,xt1,lx,f0,f1 As Integer
          Dim xv As Double
          Dim ov As point3d
          k = 0

          If (((EdgeConnectedFaces.branch(j).count() = 1) And (e <> 2)) Or (EdgeConnectedFaces.branch(j).count() > 1)) Then
            If EdgeConnectedFaces.branch(j).count() > 1 Then
              FaceConnectedFaces.add(EdgeConnectedFaces.branch(j).item(0), New gh_path(EdgeConnectedFaces.branch(j).item(1)))
              FaceConnectedFaces.add(EdgeConnectedFaces.branch(j).item(1), New gh_path(EdgeConnectedFaces.branch(j).item(0)))

              efc.add(j & "_" & EdgeConnectedFaces.branch(j).item(0), EdgeConnectedFaces.branch(j).item(1))
              efc.add(j & "_" & EdgeConnectedFaces.branch(j).item(1), EdgeConnectedFaces.branch(j).item(0))

              lx = EdgeConnectedFaces.branch(j).item(1)
              epline.add(facecenters.branch(lx).item(0))
              tda.add(k, aft.item(lx))
              k += 1
            End If
            xt0 = TopologyEdges.item(j).t0
            xt1 = TopologyEdges.item(j).t1
            evc.add(j & "_" & xt0, xt1)
            evc.add(j & "_" & xt1, xt0)

            cc = VertConnectedVertices.branch(xt0).count()
            xv = (4 - 2 * math.Cos(2 * math.PI / cc)) / 9
            ov = offsetVert(xt0) / cc
            f0 = VertConnectedFaces.branch(xt0).count()
            If ((e = 0) And (NakedVertexStatus(xt0))) Then
              epline.add(vertices(xt0))
              tda.add(k, st(xt0) / f0)
            Else
              epline.add(evalP(vertices(xt0), vertices(xt0) * (1 - xv) + ov * xv, st(xt0) / f0))
              tda.add(k, st(xt0) / f0)
            End If
            k += 1
            lx = EdgeConnectedFaces.branch(j).item(0)
            epline.add(facecenters.branch(lx).item(0))
            tda.add(k, aft.item(lx))
            k += 1

            cc = VertConnectedVertices.branch(xt1).count()
            xv = (4 - 2 * math.Cos(2 * math.PI / cc)) / 9
            ov = offsetVert(xt1) / cc
            f1 = VertConnectedFaces.branch(xt1).count()
            If ((e = 0) And (NakedVertexStatus(xt1))) Then
              epline.add(vertices(xt1))
              tda.add(k, st(xt1) / f1)
            Else
              epline.add(evalP(vertices(xt1), vertices(xt1) * (1 - xv) + ov * xv, st(xt1) / f1))
              tda.add(k, st(xt1) / f1)
            End If
            k += 1
            epline.add(epline(0))
            tda.add(k, tda.item(0))

            arrPline.add(epline)
            tt.add(tda)
          End If
        Next

        P = arrPline
        B = tt
      Next

      Dim mxo As New mesh
      Dim mt As New list(Of mesh)
      For j = 0 To P.count() - 1 Step 1
        Dim mx As New mesh
        mx.Vertices.AddVertices(p(j))
        If p(j).count() > 5 Then
          mx.faces.addfaces(p.item(j).TriangulateClosedPolyline())
        ElseIf p(j).count() = 5 Then
          mx.Faces.AddFace(New meshface(0, 1, 2, 3))
        Else
          mx.Faces.AddFace(New meshface(0, 1, 2))
        End If
        mxo.Append(mx)
      Next
      mxo.Weld(math.pi)
      mxo.UnifyNormals()
      mxo.FaceNormals.ComputeFaceNormals()
      mxo.Normals.ComputeNormals()

      VP = p
      M = mxo
    End If
# ---------- m_modkobbelt: VB additional code ----------
  Private Function dblmatch(ByVal arrD As Dictionary(Of Integer,Object), ByVal t As Integer)
    Dim i,j As Integer
    j = arrD.count()

    For i = j - 1 To t - 1 Step 1
      arrD.add(i + 1, arrD.item(j - 1))
    Next

    Return arrD
  End Function

  Private Function append(ByVal j As Integer)
    Dim srsEnum As IEnumerable(Of Integer) = Enumerable.Range(0, j + 1)
    Dim arrVal As New list(Of Integer)
    arrVal = srsEnum.tolist()
    arrVal.add(0)
    Return arrVal.toarray()
  End Function

  Private Function series(ByVal j As Integer)
    Dim srsEnum As IEnumerable(Of Integer) = Enumerable.Range(0, j)
    Dim arrVal As New list(Of Integer)
    arrVal = srsEnum.tolist()
    Return arrVal
  End Function

  Private Function evalP(ByVal op As point3d, ByVal tp As Point3d, ByVal W As Double)
    Return New point3d(op + (tp - op) * W)
  End Function
# ---------- end m_modkobbelt ----------
mesh_3 = Mesh()
mesh_4 = Mesh()
mesh_5 = Mesh()

# ---- group: Strip Colour
stripper = Stripper(Mesh=mesh_4)
dispatch = Dispatch(List=stripper, DispatchPattern=[True, False])  # -> ListA, ListB
panel = Panel(dispatch.ListA)
preview = CustomPreview(Geometry=dispatch.ListA, Material=ColourSwatch(SwatchColor=RGB(255, 13, 255)))
preview_2 = CustomPreview(Geometry=dispatch.ListB, Material=ColourSwatch(SwatchColor=RGB(0, 0, 0)))

# ---- group: Checkerboard
checkerboard = Checkerboard(Mesh=mesh_5)
explode = MeshExplode(Mesh=mesh_5, Interpolate=False)
dispatch_2 = Dispatch(List=explode, DispatchPattern=checkerboard)  # -> ListA, ListB
preview_3 = CustomPreview(Geometry=dispatch_2.ListA, Material=ColourSwatch(SwatchColor=RGB(255, 13, 255)))
preview_4 = CustomPreview(Geometry=dispatch_2.ListB, Material=ColourSwatch(SwatchColor=RGB(255, 255, 255)))

# ----
checkerboard_2 = Checkerboard(Mesh=mesh_5)
checkerboard_3 = Checkerboard(Mesh=mesh_5)
checkerboard_4 = Checkerboard(Mesh=mesh_5)

# ---- group: WeftLines
warpweft = WarpWeft(Mesh=mesh_3)  # -> Warp, Weft, NakedA, NakedB
number_slider = Slider(1.7, range=-0.9..5)
crv = Curve(warpweft.Warp)
preview_5 = CustomPreview(Geometry=mesh_3, Material=ColourSwatch(SwatchColor=RGB(0, 0, 76)))
mpipe = MeshPipe(Curve=crv, Radius="0.8", Accuracy=0.2, Rotation=0, Segments=10, Caps=2)
preview_6 = CustomPreview(Geometry=mpipe, Material=ColourSwatch(SwatchColor=RGB(255, 13, 255)))
