# Grasshopper definition smthspce_25_noiseV1.gh (Grasshopper 1.0.8)
# plug-ins: Noise 4D

number_slider = Slider(100, range=0..200)
rectangle = Rectangle(Plane=PlaneXY(0, 0, 0), XSize=number_slider, YSize=number_slider, Radius=0)  # -> Rectangle, Length
boundary_surfaces = BoundarySurfaces(Edges=rectangle.Rectangle)
divide_surface = DivideSurface(Surface=boundary_surfaces, UCount=Slider(51, range=0..100), VCount=Slider(210, range=0..300))  # -> Points, Normals, Parameters
number_slider_2 = Slider(0.12, range=0..0.3)
number_slider_3 = Slider(0, range=0..1)
point = Point(divide_surface.Points)
simplexnoise = SimplexNoise(Values=point, Time=number_slider_3, Scale=number_slider_2)
perlinnoise = PerlinNoise(Values=point, Time=number_slider_3, Scale=number_slider_2)
deconstruct = Deconstruct(Point=point)  # -> XComponent, YComponent, ZComponent
addition = Addition(A=deconstruct.XComponent, B=simplexnoise)
multiplication = Multiplication(A=simplexnoise, B=Slider(2, range=0..2))
cosine = Cosine(Value=multiplication)
sine = Sine(Value=multiplication)
multiplication_2 = Multiplication(A=sine, B=Slider(1.644, range=0..5))
unit_y = UnitY(Factor=multiplication_2)
move = Move(Geometry=point, Motion=unit_y)  # -> Geometry, Transform
point_2 = Point(move.Geometry)
flip_matrix = FlipMatrix(Data=point_2)
interpolate = Interpolate(Vertices=flip_matrix, Degree=3, Periodic=False, KnotStyle=1)  # -> Curve, Length, Domain
curve = Curve(interpolate.Curve)
