# Grasshopper definition smthspce_26_noiseV2.gh (Grasshopper 1.0.8)
# plug-ins: Noise 4D

number_slider = Slider(100, range=0..200)
rectangle = Rectangle(Plane=PlaneXY(0, 0, 0), XSize=number_slider, YSize=number_slider, Radius=0)  # -> Rectangle, Length
boundary_surfaces = BoundarySurfaces(Edges=rectangle.Rectangle)
divide_surface = DivideSurface(Surface=boundary_surfaces, UCount=Slider(51, range=0..100), VCount=Slider(210, range=0..300))  # -> Points, Normals, Parameters
point = Point(divide_surface.Points)
simplexnoise = SimplexNoise(Values=point, Time=Slider(0, range=0..1), Scale=Slider(0.14, range=0..0.3))
deconstruct = Deconstruct(Point=point)  # -> XComponent, YComponent, ZComponent
bounds = Bounds(Numbers=deconstruct.YComponent)
remap_numbers = RemapNumbers(Value=deconstruct.XComponent, Source=bounds, Target="0 to 2")  # -> Mapped, Clipped
multiplication = Multiplication(A=deconstruct.YComponent, B=remap_numbers.Mapped)
bounds_2 = Bounds(Numbers=deconstruct.YComponent)
multiplication_2 = Multiplication(A=deconstruct.YComponent, B=simplexnoise)
multiplication_3 = Multiplication(A=simplexnoise, B=Slider(0.9, range=0..2))
remap_numbers_2 = RemapNumbers(Value=deconstruct.YComponent, Source=bounds_2, Target="3 to 0")  # -> Mapped, Clipped
sine = Sine(Value=multiplication_3)
multiplication_4 = Multiplication(A=sine, B=Slider(1.428, range=0..5))
unit_y = UnitY(Factor=multiplication_4)
multiplication_5 = Multiplication(A=remap_numbers_2.Mapped, B=unit_y)
move = Move(Geometry=point, Motion=multiplication_5)  # -> Geometry, Transform
point_2 = Point(move.Geometry)
flip_matrix = FlipMatrix(Data=point_2)
interpolate = Interpolate(Vertices=flip_matrix, Degree=3, Periodic=False, KnotStyle=1)  # -> Curve, Length, Domain
curve = Curve(interpolate.Curve)
